# Grasshopper definition 0801_RoomsWallsDoorsToGraph.gh (Grasshopper 1.0.8)
# plug-ins: Karamba3D, Heteroptera, RhinoInside.Revit.GH

category = Category(<category referenced from the Revit model>)
category_filter = CategoryFilter(Categories=category, Inverted=False)
query_elements = QueryElements(Filter=category_filter, Limit=100)  # -> Elements, Count
element_geometry = ElementGeometry(Elements=query_elements.Elements, DetailLevel=3)
bounding_box = BoundingBox(Content=element_geometry, Plane=PlaneXY(0, 0, 0), UnionBox=True)  # -> Box, Box_2
deconstruct_brep = DeconstructBrep(Brep=bounding_box.Box)  # -> Faces, Edges, Vertices
area = Area(Geometry=deconstruct_brep.Faces)  # -> Area, Centroid
sort_list = SortList(Keys=area.Area, ValuesValuesA=deconstruct_brep.Faces)  # -> Keys, ValuesValuesA
panel = Panel("""0
1""")
panel_2 = Panel("""4
5""")
panel_3 = Panel("""2
3""")
list_item = ListItem(List=sort_list.ValuesValuesA, Index=panel, Wrap=True)
list_item_2 = ListItem(List=sort_list.ValuesValuesA, Index=panel_2, Wrap=True)
list_item_3 = ListItem(List=sort_list.ValuesValuesA, Index=panel_3, Wrap=True)
discontinuity = Discontinuity(Curve=list_item_2, Level=1)  # -> Points, Parameters
discontinuity_2 = Discontinuity(Curve=list_item, Level=1)  # -> Points, Parameters
discontinuity_3 = Discontinuity(Curve=list_item_3, Level=1)  # -> Points, Parameters
average = Average(Input=discontinuity.Points)
average_2 = Average(Input=discontinuity_2.Points)
average_3 = Average(Input=discontinuity_3.Points)
shift_paths = ShiftPaths(Data=average, Offset=-1)
shift_paths_2 = ShiftPaths(Data=average_2, Offset=-1)
shift_paths_3 = ShiftPaths(Data=average_3, Offset=-1)
list_item_4 = ListItem(List=simplify(shift_paths), Index=graft(panel_2), Wrap=True)  # -> Item, Item1
list_item_5 = ListItem(List=simplify(shift_paths_2), Index=graft(panel), Wrap=True)  # -> Item, Item1
list_item_6 = ListItem(List=simplify(shift_paths_3), Index=graft(panel_3), Wrap=True)  # -> Item, Item1
number_slider = Slider(352, range=0..1000)
number_slider_2 = Slider(300, range=0..1000)
number_slider_3 = Slider(99, range=0..1000)
line = Line(StartPoint=list_item_4.Item, EndPoint=list_item_4.Item1)
line_2 = Line(StartPoint=list_item_5.Item, EndPoint=list_item_5.Item1)
line_3 = Line(StartPoint=list_item_6.Item, EndPoint=list_item_6.Item1)
extend_curve = ExtendCurve(Curve=line, Type=0, Start=number_slider, End=number_slider)
extend_curve_2 = ExtendCurve(Curve=line_2, Type=0, Start=number_slider_2, End=number_slider_2)
extend_curve_3 = ExtendCurve(Curve=line_3, Type=0, Start=number_slider_3, End=number_slider_3)
merge = Merge(Data1=extend_curve, Data2=extend_curve_2, Data3=extend_curve_3)
bounding_box_2 = BoundingBox(Content=merge, Plane=PlaneXY(0, 0, 0), UnionBox=True)  # -> Box, Box_2

wall_system_family = WallSystemFamily({"Basic": 0, "Curtain": 1, "Stacked": 2}, selected="Basic")
query_walls = QueryWalls(WallSystemFamily=wall_system_family)
element_geometry_2 = ElementGeometry(Elements=query_walls, DetailLevel=3)
deconstruct_brep_2 = DeconstructBrep(Brep=element_geometry_2)  # -> Faces, Edges, Vertices
brep = Brep(deconstruct_brep_2.Faces)

analyze_wall_location_curve = AnalyzeWallLocationCurve(Wall=query_walls)  # -> LocationLine, CenterCurve, LocationCurve, OffsetValue
curve = Curve(analyze_wall_location_curve.CenterCurve)
line_line_intersection_karamba3d = LineLineIntersectionKaramba3D(IntersectingLines=curve, LinesToIntersect=curve, LimitDistance_m=0.005)  # -> InterSecPoints, LineSubSegments
tree_statistics = TreeStatistics(Tree=line_line_intersection_karamba3d.LineSubSegments)  # -> Paths, Length, Count
partition_list = PartitionList(List=line_line_intersection_karamba3d.InterSecPoints, Size=tree_statistics.Length)
curve_closest_point = CurveClosestPoint(Point=partition_list, Curve=reparameterize(graft(curve)))  # -> Point, Parameter, Distance
equality = Equality(FirstNumber=curve_closest_point.Parameter, SecondNumber="1")  # -> Equality, Inequality
cull_pattern = CullPattern(List=curve_closest_point.Parameter, CullPattern=equality.Inequality)
perp_frame = PerpFrame(Curve=reparameterize(graft(curve)), Parameter=cull_pattern)

area_2 = Area(Geometry=brep)  # -> Area, Centroid
deconstruct = Deconstruct(Point=area_2.Centroid)  # -> XComponent, YComponent, ZComponent
min_max = MinMax(Number=deconstruct.ZComponent)  # -> Minimum, Maximum
equality_2 = Equality(FirstNumber=deconstruct.ZComponent, SecondNumber=min_max.Maximum)  # -> Equality, Inequality
cull_pattern_2 = CullPattern(List=brep, CullPattern=equality_2.Equality)
brep_2 = Brep(flatten(brep))
shape_in_brep = ShapeInBrep(Brep=bounding_box_2.Box, Shape=brep_2)
inside = Panel("0")
equality_3 = Equality(FirstNumber=shape_in_brep, SecondNumber=inside)  # -> Equality, Inequality
cull_pattern_3 = CullPattern(List=brep_2, CullPattern=equality_3.Equality)
area_3 = Area(Geometry=cull_pattern_3)  # -> Area, Centroid
deconstruct_2 = Deconstruct(Point=area_3.Centroid)  # -> XComponent, YComponent, ZComponent
sort_list_2 = SortList(Keys=deconstruct_2.ZComponent, ValuesValuesA=cull_pattern_3)  # -> Keys, ValuesValuesA
list_item_7 = ListItem(List=sort_list_2.ValuesValuesA, Index=0, Wrap=True)  # -> Item1, Item
top_door_surfaces = Surface(list_item_7.Item1)

levels_picker = LevelsPicker(<levels picker referenced from the Revit model>)
query_rooms = QueryRooms(Placed=True, Level=levels_picker)
level = Level(levels_picker)
spatial_element_geometry = SpatialElementGeometry(SpatialElement=query_rooms, BoundaryLocation=0)  # -> Geometry, TopFaces, SideFaces, BottomFaces

# ----
# Project rooms and door's top to the elevation of the chosen Revit level,
# so all rooms are in the same height (elevation).
panel_4 = Panel("Elevation")
element_parameter = ElementParameter(Element=level, Parameter=panel_4)  # -> Element, Value
construct_point = ConstructPoint(XCoordinate=0, YCoordinate=0, ZCoordinate=element_parameter.Value)
xy_plane = XYPlane(Origin=construct_point)

project = Project(Geometry=spatial_element_geometry.BottomFaces, Plane=xy_plane)  # -> Geometry, Transform

project_2 = Project(Geometry=cull_pattern_2, Plane=xy_plane)  # -> Geometry, Transform
brep_plane = BrepPlane(Brep=project_2.Geometry, Plane=perp_frame)  # -> Curves, Points
shift_paths_4 = ShiftPaths(Data=brep_plane.Curves, Offset=-1)
surface_split = SurfaceSplit(Surface=project_2.Geometry, Curves=shift_paths_4)  # -> simplify(Fragments)
project_3 = Project(Geometry=top_door_surfaces, Plane=xy_plane)  # -> Geometry, Transform

top_door_surfaces_2 = Surface(project_3.Geometry)
rooms = Brep(project.Geometry)
walls = Surface(surface_split)

# ----
# Selecting Walls with Doors
# (keeping tree structure)
area_4 = Area(Geometry=top_door_surfaces_2)  # -> Area, Centroid
point_in_curve = PointInCurve(Point=flatten(area_4.Centroid), Curve=graft(walls))  # -> Relationship, Point
equality_4 = Equality(FirstNumber=point_in_curve.Relationship, SecondNumber="2")  # -> Equality, Inequality
cull_pattern_4 = CullPattern(List=point_in_curve.Relationship, CullPattern=equality_4.Equality)
boolean = Boolean(cull_pattern_4)
null_item = NullItem(Item=boolean)  # -> NullFlags, InvalidFlags, Description
dispatch = Dispatch(List=graft(walls), DispatchPattern=null_item.NullFlags)  # -> ListA, ListB

# ----
# Spliting walls with doors in two equal parts
# (keeping tree structure)
discontinuity_4 = Discontinuity(Curve=dispatch.ListB, Level=1)  # -> Points, Parameters
list_item_8 = ListItem(List=discontinuity_4.Points, Index=0, Wrap=True)  # -> Item, Item1, Item2, Item3
construct_point_2 = ConstructPoint(XCoordinate="0.5", YCoordinate="0.5", ZCoordinate=0)
_4point_surface = _4PointSurface(CornerA=list_item_8.Item, CornerB=list_item_8.Item1, CornerC=list_item_8.Item2, CornerD=list_item_8.Item3)
iso_curve = IsoCurve(Surface=reparameterize(_4point_surface), UVPoint=construct_point_2)  # -> UIsocurve, VIsocurve
surface_split_2 = SurfaceSplit(Surface=_4point_surface, Curves=iso_curve.VIsocurve)
unit_z = UnitZ(Factor="2500")
extrude = Extrude(Base=surface_split_2, Direction=unit_z)
point = Point(area_4.Centroid)
brep_3 = Brep(simplify(extrude))
clean_tree = CleanTree(RemoveNulls=True, RemoveInvalid=True, RemoveEmpty=True, Tree=brep_3)
mesh_sphere = MeshSphere(Base=point, Radius=Slider(12, range=0..100), UCount=10, VCount=20)
clash = Clash(FirstSet=flatten(mesh_sphere), SecondSet=clean_tree, Distance=0, ResultLimit=100)  # -> ClashCount, ClashPoints, ClashRadii, FirstIndex, SecondIndex
boolean_2 = Boolean(invert(clash.SecondIndex))
integer = Integer(boolean_2)
list_item_9 = ListItem(List=clean_tree, Index=clash.SecondIndex, Wrap=True)
list_item_10 = ListItem(List=clean_tree, Index=integer, Wrap=True)

clean_tree_2 = CleanTree(RemoveNulls=True, RemoveInvalid=True, RemoveEmpty=False, Tree=flatten(rooms))

# ----
# Walls without doors
brep_4 = Brep(dispatch.ListA)
extrude_2 = Extrude(Base=brep_4, Direction=unit_z)

extrude_3 = Extrude(Base=clean_tree_2, Direction=unit_z)

walls_with_doors = Brep(list_item_10)
walls_without_doors = Brep(extrude_2)
rooms_2 = Brep(extrude_3)
doors = Brep(list_item_9)

brep_edges = BrepEdges(Brep=rooms_2)  # -> Naked, Interior, NonManifold
custom_preview = CustomPreview(Geometry=brep_edges.Interior, Material=ColourSwatch(SwatchColor=RGB(227, 227, 227)))
custom_preview_2 = CustomPreview(Geometry=walls_with_doors, Material=ColourSwatch(SwatchColor=RGB(61, 161, 255)))
custom_preview_3 = CustomPreview(Geometry=doors, Material=ColourSwatch(SwatchColor=RGB(61, 113, 255)))
custom_preview_4 = CustomPreview(Geometry=walls_without_doors, Material=ColourSwatch(SwatchColor=RGB(61, 161, 255)))
